# Grasshopper definition P_WO_000.gh (Grasshopper 1.0.7)
# plug-ins: Human, Bifocals

series = Series(Start=0, Step="6", Count="51")
sine = Sine(Value=series)
cosine = Cosine(Value=series)
number = Number(27)
number_2 = Number(29)
multiplication = Multiplication(A=cosine, B=number_2)
multiplication_2 = Multiplication(A=sine, B=number)
construct_point = ConstructPoint(XCoordinate=series, YCoordinate=multiplication_2, ZCoordinate=multiplication)
step = Slider(46.36, range=0..108)
number_3 = Number(40)
unit_z = UnitZ(Factor=number_3)
dispatch = Dispatch(List=construct_point, DispatchPattern=[True, False])  # -> ListA, ListB
radius = Slider(1.3, range=0..10)
range = Range(Domain=Domain(0, 1), Steps=step)
radius_2 = Slider(1.3, range=0..10)
move = Move(Geometry=dispatch.ListA, Motion=unit_z)  # -> Geometry, Transform
move_2 = Move(Geometry=dispatch.ListB, Motion=unit_z)  # -> Geometry, Transform
construct_domain = ConstructDomain(DomainStart=range, DomainEnd=1)
multiplication_3 = Multiplication(A=radius, B=2)
sphere = Sphere(Base=move.Geometry, Radius=radius_2)
sphere_2 = Sphere(Base=move_2.Geometry, Radius=multiplication_3)
colour_hsl = ColourHSL(Alpha=construct_domain, Hue=0, Saturation=1, Luminance=0.5)
interpolate = Interpolate(Vertices=move.Geometry, Degree=3, Periodic=False, KnotStyle=1)  # -> Curve, Length, Domain
weave = Weave(Pattern=[0, 1], Stream0=sphere, Stream1=sphere_2, NullGaps=False)
radius_3 = Slider(0.2, range=0..1)
custom_preview_materials = CustomPreviewMaterials(DiffuseColor=colour_hsl)
pipe = Pipe(Curve=interpolate.Curve, Radius=radius_3, Caps=0)
