# Grasshopper definition WO_01.gh (Grasshopper 1.0.7)

ex1 = Slider(30, range=0..100)
ex2 = Slider(29, range=0..100)
y = Slider(7, range=0..100)
x = Slider(5, range=0..100)
# Workout # 001
xy_plane = XYPlane(Origin=Point(0, 0, 0))
x_2 = Slider(5, range=0..100)
y_2 = Slider(6, range=0..100)
rectangular = Rectangular(Plane=xy_plane, SizeX=x, SizeY=y, ExtentX=ex1, ExtentY=ex2)  # -> Cells, Points
curve = Curve(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)
curve_2 = Curve(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)
curve_3 = Curve(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)
rectangle = Rectangle(Plane=rectangular.Points, XSize=x_2, YSize=y_2, Radius=0)  # -> Rectangle, Length
start = Slider(0, range=0..2)
end = Slider(1.2, range=0..31)
curve_closest_point = CurveClosestPoint(Point=rectangular.Points, Curve=curve)  # -> Point, Parameter, Distance
curve_4 = Curve(rectangle.Rectangle)
construct_domain = ConstructDomain(DomainStart=start, DomainEnd=end)
bounds = Bounds(Numbers=curve_closest_point.Distance)
remap_numbers = RemapNumbers(Value=curve_closest_point.Distance, Source=bounds, Target=construct_domain)  # -> Mapped, Clipped
unit_z = UnitZ(Factor=remap_numbers.Mapped)
graph_mapper = GraphMapper(unit_z, x0=0, x1=1, y0=0, y1=1, container_name="Sine", Equation_px=[0, 1], Equation_py=[0, 1])
multiplication = Multiplication(A=graph_mapper, B=6)
box_rectangle = BoxRectangle(Rectangle=curve_4, Height=multiplication)
