# Grasshopper definition alBaharFacade-typeB.gh (Grasshopper 1.0.7)
# plug-ins: Bifocals

xz_plane = XZPlane(Origin=Point(0, 0, 0))
unit_y = UnitY(Factor=Slider(0.2, range=0..1))
negative = Negative(Value=unit_y)
triangular = Triangular(Plane=xz_plane, Size=Slider(3, range=0..100), ExtentX=Slider(7, range=0..100), ExtentY=Slider(3, range=0..100))  # -> graft(Cells), Points
extrude = Extrude(Base=triangular.Cells, Direction=[negative, unit_y])
# ALBHR TOWER  SUNSHADES
explode = Explode(Curve=triangular.Cells, Recursive=True)  # -> Segments, Vertices

md_slider = MDSlider(
    SliderMode=0,
    slider_value=Point(0, 0.9994222593, 0.5),
    x_domain=Domain(0, 1),
    y_domain=Domain(0, 1),
    z_domain=Domain(0, 1))
md_slider_2 = MDSlider(SliderMode=0, slider_value=Point(1, 0, 0.5), x_domain=Domain(0, 1), y_domain=Domain(0, 1), z_domain=Domain(0, 1))
point = Point(explode.Vertices)
bounding_box = BoundingBox(Content=flatten(point), Plane=PlaneXY(0, 0, 0), UnionBox=True)  # -> Box, Box_2
evaluate_surface = EvaluateSurface(Surface=reparameterize(bounding_box.Box), Point=[md_slider_2, md_slider])  # -> Point, Normal, UDirection, VDirection, Frame

area = Area(Geometry=triangular.Cells)  # -> Area, Centroid
unit_y_2 = UnitY(Factor=1)
point_on_curve = PointOnCurve(explode.Segments, parameter=0.5)
negative_2 = Negative(Value=unit_y_2)
line_sdl = LineSDL(Start=area.Centroid, Direction=negative_2, Length=Slider(0.53, range=0..10))
closest_point = ClosestPoint(Point=area.Centroid, Cloud=evaluate_surface.Point)  # -> ClosestPoint, CPIndex, Distance
end_points = EndPoints(Curve=line_sdl)  # -> Start, End
bounds = Bounds(Numbers=flatten(closest_point.Distance))
construct_domain = ConstructDomain(DomainStart=Slider(0.55, range=0..1), DomainEnd=Slider(1.4, range=0..5))
line = Line(StartPoint=point_on_curve, EndPoint=end_points.Start)
remap_numbers = RemapNumbers(Value=closest_point.Distance, Source=bounds, Target=construct_domain)  # -> Mapped, Clipped
point_2 = Point(explode.Vertices)
point_on_curve_2 = PointOnCurve(line, parameter=0.399)
list_item = ListItem(List=point_2, Index=0, Wrap=True)  # -> Item, Item1, Item2

line_2 = Line(StartPoint=list_item.Item, EndPoint=end_points.End)
line_3 = Line(StartPoint=list_item.Item1, EndPoint=end_points.End)
line_4 = Line(StartPoint=list_item.Item2, EndPoint=end_points.End)

polyline = PolyLine(Vertices=point_on_curve_2, Closed=True)
scale = Scale(Geometry=polyline, Center=area.Centroid, Factor=remap_numbers.Clipped)  # -> Geometry, Transform
explode_2 = Explode(Curve=scale.Geometry, Recursive=True)  # -> Segments, Vertices
point_3 = Point(explode_2.Vertices)
list_item_2 = ListItem(List=point_3, Index=0, Wrap=True)  # -> Item, Item1, Item2

line_5 = Line(StartPoint=list_item_2.Item, EndPoint=list_item.Item)
line_6 = Line(StartPoint=list_item_2.Item, EndPoint=list_item.Item1)
line_7 = Line(StartPoint=list_item_2.Item1, EndPoint=list_item.Item1)
line_8 = Line(StartPoint=list_item_2.Item1, EndPoint=list_item.Item2)
line_9 = Line(StartPoint=list_item_2.Item2, EndPoint=list_item.Item2)
line_10 = Line(StartPoint=list_item_2.Item2, EndPoint=list_item.Item)

line_11 = Line(StartPoint=list_item_2.Item, EndPoint=end_points.End)
line_12 = Line(StartPoint=list_item_2.Item2, EndPoint=end_points.End)
line_13 = Line(StartPoint=list_item_2.Item1, EndPoint=end_points.End)

merge = Merge(Data1=line_5, Data2=line_11, Data3=line_2)  # -> flatten(Result)
merge_2 = Merge(Data1=line_10, Data2=line_12, Data3=line_2)  # -> flatten(Result)
merge_3 = Merge(Data1=line_6, Data2=line_3, Data3=line_11)  # -> flatten(Result)
merge_4 = Merge(Data1=line_9, Data2=line_12, Data3=line_4)  # -> flatten(Result)
merge_5 = Merge(Data1=line_7, Data2=line_13, Data3=line_3)  # -> flatten(Result)
merge_6 = Merge(Data1=line_8, Data2=line_13, Data3=line_4)  # -> flatten(Result)
boundary_surfaces = BoundarySurfaces(Edges=merge)
boundary_surfaces_2 = BoundarySurfaces(Edges=merge_2)
boundary_surfaces_3 = BoundarySurfaces(Edges=merge_3)
boundary_surfaces_4 = BoundarySurfaces(Edges=merge_5)
boundary_surfaces_5 = BoundarySurfaces(Edges=merge_6)
boundary_surfaces_6 = BoundarySurfaces(Edges=merge_4)
merge_7 = Merge(
    Data1=boundary_surfaces,
    Data2=boundary_surfaces_2,
    Data3=boundary_surfaces_3,
    Data4=boundary_surfaces_4,
    Data5=boundary_surfaces_5,
    Data6=boundary_surfaces_6)
